# Grasshopper definition evaluate.ghx (Grasshopper 1.0.7)

# ---- group: RH_IN:FP1
num = Number(flatten("3.0"))

# ---- group: RH_IN:FP2
num_2 = Number(flatten("1.0"))

# ---- group: RH_IN:FP3
num_3 = Number(flatten("1.0"))

# ---- group: RH_IN:FP4
num_4 = Number(flatten("1.0"))

# ---- group: RH_IN:FP5
num_5 = Number(flatten("1.0"))

# ---- group: RH_IN:FP6
num_6 = Number(flatten("1.0"))

# ---- group: RH_IN:FP7
num_7 = Number(flatten("1.0"))

# ---- group: RH_IN:FP8
num_8 = Number(flatten("1.0"))

# ---- group: RH_IN:FP9
num_9 = Number(flatten("0.0"))

# ---- group: RH_IN:OP1
num_10 = Number(flatten("0.5"))

# ---- group: RH_IN:OP2
num_11 = Number(flatten("0.5"))

# ----
merge = Merge(Data1=num, Data2=num_2, Data3=num_3, Data4=num_4, Data5=num_5, Data6=num_6, Data7=num_7, Data8=num_8, Data9=num_9)
srf = Surface(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)
pt = ConstructPoint(XCoordinate=num_10, YCoordinate=num_11, ZCoordinate=0)
srfpt = SurfacePoints(Surface=srf)  # -> Points, Weights, Greville, UCount, VCount
pdecon = Deconstruct(Point=srfpt.Points)  # -> XComponent, YComponent, ZComponent
pt_2 = ConstructPoint(XCoordinate=pdecon.XComponent, YCoordinate=pdecon.YComponent, ZCoordinate=merge)
srfgrid = SurfaceFromPoints(Points=pt_2, UCount="3", Interpolate=False)  # -> reparameterize(Surface)
evalsrf = EvaluateSurface(Surface=reparameterize(srfgrid), Point=pt)  # -> Point, Normal, UDirection, VDirection, Frame
pdecon_2 = Deconstruct(Point=evalsrf.Point)  # -> XComponent, YComponent, flatten(ZComponent)

# ---- group: RH_OUT:F1
num_12 = Number(pdecon_2.ZComponent)
