# Grasshopper definition BoundaryDracoByID.gh (Grasshopper 1.0.7)
# plug-ins: Geospatial

path = FilePath("C:\Users\Anna Yenardi\Singapore University of Technology and Design\Peter Ortner - 2022_UrbanDesignOptimization\03_Models\05_Intergrated models & showcase\Node Three Spawner example\static\geojson\Clean_MP19_LandUse_Tampines.geojson")
readjson = ReadGeoJSON(File=path)  # -> Type, simplify(Geometry), Keys, simplify(Values)
curve = Curve(readjson.Geometry)
text = Text(readjson.Values)
python = GhPythonScript(LU_GEO=curve, LU_PROP=text, thickness=Slider(1, range=0..1))  # -> out, simplify(IDS), simplify(GEO); inputs LU_GEO: tree of Curve, LU_PROP: tree, thickness: tree
# ---------- python: Python ----------
__author__ = "Admin"
__version__ = "2022.09.14"

import rhinoscriptsyntax as rs
import ghpythonlib.components as gh
import ghpythonlib.treehelpers as th

a = []
ids = []
geometries = []

for path in LU_GEO.Paths:
    
    #if LU_PROP.Branch(path)[1] != 'RESIDENTIAL WITH COMMERCIAL AT 1ST STOREY':
    
    geo_set = []
    ids.append([LU_PROP.Branch(path)[10]])
    parcel_crv = LU_GEO.Branch(path)[0]
    crv = gh.JoinCurves(parcel_crv, False)
    outer_ring = gh.BoundarySurfaces(gh.OffsetCurve(parcel_crv, thickness, corners=2))
    inner_ring = gh.BoundarySurfaces(crv)
    ring = gh.SolidDifference(outer_ring, inner_ring)
    parcel_bound = gh.Extrude(ring, gh.UnitZ(1))
    geometries.append(parcel_bound)

IDS = th.list_to_tree(ids)
GEO = th.list_to_tree(geometries)
# ---------- end python ----------
mesh = MeshBrep(
    Brep=python.GEO,
    Settings={GridMaxCount=0, GridMinCount=16, JaggedSeams=False, MaxEdgeLength=0, MinEdgeLength=0.0001, MinTolerance=0, Refine=True, RefineAngle=0, RelativeTolerance=0.65, SimplePlanes=True, Tolerance=0})
panel = Panel(python.IDS)
c_script = CSharpScript(mesh=mesh)  # -> base64Draco; inputs mesh: Mesh
# ---------- c_script: C# ----------
    var options = new Rhino.FileIO.DracoCompressionOptions();
    options.CompressionLevel = 5;
    options.IncludeTextureCoordinates = false;
    options.IncludeVertexColors = false;

    var compressed = Rhino.FileIO.DracoCompression.Compress(mesh, options);
    base64Draco = compressed.ToBase64String();
# ---------- end c_script ----------
python_2 = GhPythonScript(IDS=python.IDS, DRACO=simplify(graft(c_script)))  # -> out, JSON; inputs IDS: tree, DRACO: tree
# ---------- python_2: Python ----------
__author__ = "Admin"
__version__ = "2022.09.14"

import rhinoscriptsyntax as rs
import json

ans = {}

for path in IDS.Paths:
    ans[IDS.Branch(path)[0]] = DRACO.Branch(path)[0]

JSON = json.dumps(ans)
# ---------- end python_2 ----------
file_path = FilePath("C:\Users\Anna Yenardi\Downloads\")
write_file = WriteFile(Directory=file_path, Filename="trialParcel.json", Data=python_2.JSON, Run=Toggle(True))

# ---- group: RH_OUT:Mesh
mesh_2 = Text(python_2.JSON)
