# Grasshopper definition GroupDracoByID.gh (Grasshopper 1.0.7)
# plug-ins: Geospatial

path = FilePath("C:\Users\jingz\OneDrive - Singapore University of Technology and Design\2022_UrbanDesignOptimization\02_Presentations\03_Conference\202209_CaadFutures\Site Generation\results\3857\Clean_MP19_LandUse_Tampines.geojson")
path_2 = FilePath("C:\Users\jingz\OneDrive - Singapore University of Technology and Design\2022_UrbanDesignOptimization\02_Presentations\03_Conference\202209_CaadFutures\Site Generation\results\3857\Clean_OSM_Buildings_Tampines.geojson")
readjson = ReadGeoJSON(File=path)  # -> Type, simplify(Geometry), Keys, simplify(Values)
readjson_2 = ReadGeoJSON(File=path_2)  # -> Type, simplify(Geometry), Keys, simplify(Values)
curve = Curve(readjson.Geometry)
curve_2 = Curve(readjson_2.Geometry)
text = Text(readjson.Values)
text_2 = Text(readjson_2.Values)
python = GhPythonScript(LU_GEO=curve, LU_PROP=text, BG_GEO=curve_2, BG_PROP=text_2)  # -> out, simplify(IDS), simplify(GEO); inputs LU_GEO: tree of Curve, LU_PROP: tree, BG_GEO: tree of Curve, BG_PROP: tree
# ---------- python: Python ----------
__author__ = "Admin"
__version__ = "2022.09.14"

import rhinoscriptsyntax as rs
import ghpythonlib.components as gh
import ghpythonlib.treehelpers as th

def SolidExtrude(crv,height):
    srf = gh.BoundarySurfaces(crv)
    return gh.Extrude(srf,gh.UnitZ(height))

a = []
ids = []
geometries = []

bldg_centroids = [gh.Area(BG_GEO.Branch(path)[0])[1] for path in BG_GEO.Paths]

for path in LU_GEO.Paths:
    
    #if LU_PROP.Branch(path)[1] != 'RESIDENTIAL WITH COMMERCIAL AT 1ST STOREY':
    
    geo_set = []
    ids.append([LU_PROP.Branch(path)[10]])
    parcel_crv = LU_GEO.Branch(path)[0]
    geo_set.append(SolidExtrude(parcel_crv,1))
    
    bg_index = [i for i,pt in enumerate(bldg_centroids) if gh.PointInCurve(pt,parcel_crv)[0]==2]
    print(bg_index)
    if len(bg_index) != 0:
        for bg_i in bg_index:
            bg_crv = BG_GEO.Branch(bg_i)[0]
            try:
                bg_height = float(BG_PROP.Branch(bg_i)[5]) * 3.5
            except:
                bg_height = 4 * 3.5
            geo_set.append(SolidExtrude(bg_crv,bg_height))
    geometries.append(geo_set)

IDS = th.list_to_tree(ids)
GEO = th.list_to_tree(geometries)
# ---------- end python ----------
mesh = MeshBrep(
    Brep=python.GEO,
    Settings={GridMaxCount=0, GridMinCount=16, JaggedSeams=False, MaxEdgeLength=0, MinEdgeLength=0.0001, MinTolerance=0, Refine=True, RefineAngle=0, RelativeTolerance=0.65, SimplePlanes=True, Tolerance=0})
mjoin = MeshJoin(Meshes=mesh)
c_script = CSharpScript(mesh=mjoin)  # -> base64Draco; inputs mesh: Mesh
# ---------- c_script: C# ----------
    var options = new Rhino.FileIO.DracoCompressionOptions();
    options.CompressionLevel = 5;
    options.IncludeTextureCoordinates = false;
    options.IncludeVertexColors = false;

    var compressed = Rhino.FileIO.DracoCompression.Compress(mesh, options);
    base64Draco = compressed.ToBase64String();
# ---------- end c_script ----------
python_2 = GhPythonScript(IDS=python.IDS, DRACO=c_script)  # -> out, JSON; inputs IDS: tree, DRACO: tree
# ---------- python_2: Python ----------
__author__ = "Admin"
__version__ = "2022.09.14"

import rhinoscriptsyntax as rs
import json

ans = {}

for path in IDS.Paths:
    ans[IDS.Branch(path)[0]] = DRACO.Branch(path)[0]

JSON = json.dumps(ans)
# ---------- end python_2 ----------
write_file = WriteFile(Filename="dracomesh.json", Data=python_2.JSON, Run=Toggle(True))

# ---- group: RH_OUT:Mesh
mesh_2 = Text(python_2.JSON)
