# Grasshopper definition module C_showcase.ghx (Grasshopper 1.0.7)

python = GhPythonScript()  # -> out, sampleString
# ---------- python: Python ----------
__author__ = "Admin"
__version__ = "2022.08.22"

import rhinoscriptsyntax as rs
import json

sampleJSON = {"LU_4_Bldg_0028": {"properties": {"storeys": 13, "orientation": {"origin": [11570015.610364, 150441.8516453, 0.0], "YAxis": [0.9247692, -0.3805285, 0.0], "XAxis": [-0.3805285, -0.9247692, 0.0]}, "obstacle": [[11570219.1703627, 150657.8788753, 0.0], [11570230.2541567, 150669.2982557,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
sampleString = json.dumps(sampleJSON)
# ---------- end python ----------

# ---- group: RH_IN:BuildingJSON
txt = Text(python.sampleString)

# ----
python_2 = GhPythonScript(BuildingJSON=txt)  # -> out, Extrusion, Polyline, Plane, Properties
# ---------- python_2: Python ----------
__author__ = "Admin"
__version__ = "2022.07.20"

import rhinoscriptsyntax as rs
import ghpythonlib.treehelpers as th
import json
import collections
import Rhino
import ghpythonlib.components as gh

def Unique(list1):
    ans = []
    for i in list1:
        if i not in ans:
            ans.append(i)
    return ans

def DictToNestedList(d):
    od = collections.OrderedDict(sorted(d.items()))
    ans = []
    for key,value in od.items():
        ans.append(value)
    return ans


json_obj = json.loads(BuildingJSON) 
json_obj = collections.OrderedDict(sorted(json_obj.items()))

uniqueParcelID = Unique([id.split('_')[2] for id in json_obj.keys()])

ExtrusionDict = {}
PolylineDict = {}
PlaneDict = {}
PropertiesDict = {}

for key in uniqueParcelID:
    ExtrusionDict[key] = []
    PolylineDict[key] = []
    PlaneDict[key] = []
    PropertiesDict[key] = []

for id, feature in json_obj.items():
    
    parcelID = id.split('_')[2]
    height = float(feature['properties']['storeys'])*3.5
    pp = feature['properties']['orientation']
    planeOrigin = Rhino.Geometry.Point3d(pp['origin'][0],pp['origin'][1],pp['origin'][2])
    planeXAxis = Rhino.Geometry.Vector3d(pp['XAxis'][0],pp['XAxis'][1],pp['XAxis'][2])
    planeYAxis = Rhino.Geometry.Vector3d(pp['YAxis'][0],pp['YAxis'][1],pp['YAxis'][2])
    plane = Rhino.Geometry.Plane(planeOrigin,planeXAxis,planeYAxis)
    polyline = Rhino.Geometry.Polyline([Rhino.Geometry.Point3d(c[0],c[1],c[2]) for c in feature['geometry']['coordinates']]).ToNurbsCurve()
    
    ExtrusionDict[parcelID].append(Rhino.Geometry.Extrusion.Create(polyline,height,True))
    PolylineDict[parcelID].append(polyline)
    PlaneDict[parcelID].append(plane)
    PropertiesDict[parcelID].append(json.dumps(feature['properties']))


Extrusion = th.list_to_tree(DictToNestedList(ExtrusionDict))

Polyline = th.list_to_tree(DictToNestedList(PolylineDict))

Plane = th.list_to_tree(DictToNestedList(PlaneDict))

Properties = th.list_to_tree(DictToNestedList(PropertiesDict))
# ---------- end python_2 ----------

bbox = BoundingBox(Content=python_2.Polyline, Plane=PlaneXY(0, 0, 0))  # -> Box, Box_2
trim = TrimTree(Tree=bbox.Box, Depth=1)
boxprop = BoxProperties(Box=trim)  # -> Center, unitize(Diagonal), Area, Volume, Degeneracy
devec = DeconstructVector(Vector=boxprop.Diagonal)  # -> XComponent, YComponent, ZComponent
division = Division(A=devec.YComponent, B=devec.XComponent)
avr = Average(Input=division)  # -> flatten(ArithmeticMean)

Z = UnitZ(Factor="3.5")
python_3 = GhPythonScript(Properties=python_2.Properties, Key="storeys")  # -> out, Values; inputs Properties: tree
# ---------- python_3: Python ----------
__author__ = "Admin"
__version__ = "2022.07.21"

import rhinoscriptsyntax as rs
import json
import ghpythonlib.treehelpers as th

Values = []
for branch in Properties.Branches:
    value = []
    for i in range(len(branch)):
        jsonObj = json.loads(branch[i])
        for key, values in jsonObj.items():
            if key == Key:
                value.append(values)
    Values.append(value)
    
Values = th.list_to_tree(Values)
# ---------- end python_3 ----------
panel = Panel("5")
arrlinear = LinearArray(Geometry=python_2.Plane, Direction=Z, Count=python_3.Values)  # -> Geometry, Transform
python_4 = GhPythonScript(Planes=arrlinear.Geometry)  # -> out, a; inputs Planes: tree of Plane
# ---------- python_4: Python ----------
__author__ = "Admin"
__version__ = "2022.07.21"

import rhinoscriptsyntax as rs
import ghpythonlib.treehelpers as th
from Grasshopper.Kernel.Data import GH_Path
from Grasshopper import DataTree


dist = 90
storeyDict = {}
for plane in Planes.AllData():
    height = float(plane.Origin.Z)
    if height not in storeyDict:
        storeyDict[height] = []
    storeyDict[height].append(plane.Origin)

ans = []
geometryTree = DataTree[object]()

for blockbranch in Planes.Paths:
    storeyplanes = Planes.Branch(blockbranch)
    blockScore = []
    for storeyplane in storeyplanes:
        height = float(storeyplane.Origin.Z)
        count = 0
        for checkpt in storeyDict[height]:
            if rs.Distance(checkpt,storeyplane.Origin) < dist:
                count +=1
        blockScore.append(count-1)
    ans.append(blockScore)
    geometryTree.AddRange(blockScore, blockbranch)

a = th.list_to_tree(ans)
a = geometryTree
# ---------- end python_4 ----------
bnd = Bounds(Numbers=flatten(python_4.a))
dedomain = DeconstructDomain(Domain=bnd)  # -> Start, End
deplane = DeconstructPlane(Plane=arrlinear.Geometry)  # -> Origin, XAxis, YAxis, ZAxis
gradient = Gradient(
    LowerLimit=dedomain.Start,
    UpperLimit=dedomain.End,
    Parameter=python_4.a,
    stops=[0: RGB(0, 128, 0), 0.5: RGB(255, 255, 0), 1: RGB(255, 0, 0)])
trim_2 = TrimTree(Tree=python_4.a, Depth=1)
ma = MassAddition(Input=trim_2)  # -> flatten(TotalViewObstruction), PartialResults
preview = CustomPreview(Geometry=deplane.Origin, Material=gradient)

# ---- group: RH_OUT:NSEWRatio
num = Number(avr)

# ---- group: RH_OUT:ViewObstruction
num_2 = Number(ma.TotalViewObstruction)
